# Grasshopper definition 2025_02-17 Entourage Facing Camera.gh (Grasshopper 1.0.8)
# plug-ins: RhinoCodePluginGH

brep = Brep(<brep referenced from the Rhino model>)
# Various methods of name matching
panel = Panel("Trees")
layername = Text(panel)
area = Area(Geometry=brep)  # -> Area, Centroid
srf_cp = SurfaceClosestPoint(Point=area.Centroid, Surface=brep)  # -> Point, UVPoint, Distance
information = ContentInformation(Content=brep)  # -> Content, Parent, Name, Tags
objects = QueryModelObjects(Layer=panel, Locked=True, Hidden=True, AutoUpdateState=True)
panel_2 = Panel(objects)
# Various methods of name matching
panel_3 = Panel("People")
evalsrf = EvaluateSurface(Surface=brep, Point=srf_cp.UVPoint)  # -> Point, Normal, UDirection, VDirection, Frame
layername_2 = Text(panel_3)
object = ModelObject(Object=objects)  # -> Object, Geometry, Name, Layer, Visibility, Display, Drafting, Render
objects_2 = QueryModelObjects(Layer=panel_3, Locked=True, Hidden=True, AutoUpdateState=True)
objects_3 = QueryModelObjects(Layer="People", Locked=True, Hidden=True, AutoUpdateState=False)
trigger = Trigger(Interval=10, TimerInterval=10, Target=py3)  # disabled
block_instance = BlockInstance(object.Object)
bbox = BoundingBox(Content=block_instance, Plane=PlaneXY(0, 0, 0))  # -> Box, Box_2
merge = Merge(Data1=area.Centroid)
object_2 = ModelObject(Object=objects_2)  # -> Object, Geometry, Name, Layer, Visibility, Display, Drafting, Render
brep_2 = Brep(object_2.Geometry)
brep_3 = Brep(brep_2)
py3 = Python3Script(pts=merge, XYforXYZ=Toggle(True), refresh=Button())  # -> out, oriented; inputs pts: Point3d, XYforXYZ: Boolean, refresh: Boolean
# ---------- py3: Python ----------
"""Grasshopper Script"""
import Rhino as rc

cameraX = rc.RhinoDoc.ActiveDoc.Views.ActiveView.ActiveViewport.CameraX
cameraY = rc.RhinoDoc.ActiveDoc.Views.ActiveView.ActiveViewport.CameraY
cameraZ = rc.Geometry.Vector3d(0.0,0.0,1.0)

def main(_pts):
    if _XYforXYZ == True:
        oriented = rc.Geometry.Plane(_pts, cameraX, cameraZ) #2D
    else:
        oriented = rc.Geometry.Plane(_pts, cameraX, cameraY) #3D
        
    return oriented

if _pts:
    oriented = main(_pts)
# ---------- end py3 ----------
block_instance_2 = ModelBlockInstance(BlockInstance=block_instance)  # -> BlockInstance, Transform, BlockDefinition
boxprop = BoxProperties(Box=bbox.Box)  # -> Center, Diagonal, Area, Volume, Degeneracy
debrep = DeconstructBrep(Brep=bbox.Box)  # -> Faces, Edges, Vertices
panel_4 = Panel(block_instance_2.Transform)
area_2 = Area(Geometry=brep_3)  # -> Area, Centroid
vlen = VectorLength(Vector=boxprop.Diagonal)
xy = XYPlane(Origin=Point(0, 0, 0))
rev = Reverse(Vector=boxprop.Diagonal)
division = Division(A=vlen, B="2")
orient = Orient(Geometry=brep, Source=evalsrf.Normal, Target=py3.oriented)  # -> Geometry, Transform
angle = Angle(VectorA=evalsrf.Normal, VectorB=py3.oriented, Plane=xy)  # -> Angle, Reflex
srf_cp_2 = SurfaceClosestPoint(Point=area_2.Centroid, Surface=brep_3)  # -> Point, UVPoint, Distance
trigger_2 = Trigger(Interval=10, TimerInterval=10, Target=py3_2)
toggle = BooleanToggle(True)
amp = Amplitude(Vector=boxprop.Diagonal, Amplitude=division)
amp_2 = Amplitude(Vector=rev, Amplitude=division)
rotate = Rotate(Geometry=brep, Angle=angle.Angle, Plane=area.Centroid)  # -> Geometry, Transform
evalsrf_2 = EvaluateSurface(Surface=brep_3, Point=srf_cp_2.UVPoint)  # -> Point, Normal, UDirection, VDirection, Frame
panel_5 = Panel("0")
merge_2 = Merge(Data1=area_2.Centroid)
move = Move(Geometry=boxprop.Center, Motion=amp)  # -> Geometry, Transform
move_2 = Move(Geometry=boxprop.Center, Motion=amp_2)  # -> Geometry, Transform
c_script = CSharpScript(brepToDelete=brep, brepToBake=rotate.Geometry)  # -> out; inputs trigger: Boolean; disabled
# ---------- c_script: C# ----------
// Grasshopper Script Instance
#region Usings
using System;
using System.Linq;
using System.Collections;
using System.Collections.Generic;
using System.Drawing;

using Rhino;
using Rhino.Geometry;

using Grasshopper;
using Grasshopper.Kernel;
using Grasshopper.Kernel.Data;
using Grasshopper.Kernel.Types;
#endregion

public class Script_Instance : GH_ScriptInstance
{
    #region Utility functions
    /// <summary>Print a String to the [Out] Parameter of the Script component.</summary>
    /// <param name="text">String to print.</param>
    private void Print(string text) { /* Implementation hidden */ }
    /// <summary>Print a formatted String to the [Out] Parameter of the Script component.</summary>
    /// <param name="format">String format.</param>
    /// <param name="args">Formatting parameters.</param>
    private void Print(string format, params object[] args) { /* Implementation hidden */ }
    /// <summary>Print useful information about an object instance to the [Out] Parameter of the Script component. </summary>
    /// <param name="obj">Object instance to parse.</param>
    private void Reflect(object obj) { /* Implementation hidden */ }
    /// <summary>Print useful information about an object instance to the [Out] Parameter of the Script component. </summary>
    /// <param name="obj">Object instance to parse.</param>
    /// <param name="method_name">Name of the method to invoke.</param>
    private void Reflect(object obj, string method_name) { /* Implementation hidden */ }
    #endregion

    #region Members
    /// <summary>Gets the current Rhino document.</summary>
    private readonly RhinoDoc RhinoDocument;
    /// <summary>Gets the current Grasshopper document.</summary>
    private readonly GH_Document GrasshopperDocument;
    /// <summary>Gets the Grasshopper script component that owns this script.</summary>
    private readonly IGH_Component Component;
    /// <summary>Gets the current iteration count.</summary>
    private readonly int Iteration;
    #endregion

    /// <summary>
    /// This procedure contains the user code. Input parameters are provided as regular arguments, 
    /// Output parameters as ref arguments. You don't have to assign output parameters, 
    /// they will have a default value.
    /// </summary>
    private void RunScript(object brepToDelete, object brepToBake, bool trigger)
    {
    
        var doc = Rhino.RhinoDoc.ActiveDoc;
    
        // For deletion: Cast to GeometryBase to get GUID
        if (brepToDelete != null)
        {
            Grasshopper.Kernel.Types.GH_Brep ghBrep = brepToDelete as Grasshopper.Kernel.Types.GH_Brep;
            if (ghBrep != null)
            {
                // Get the original object's GUID if it exists in the document
                Guid originalId;
                if (ghBrep.IsReferencedGeometry)
                {
                    originalId = ghBrep.ReferenceID;
                    doc.Objects.Delete(originalId, true);
                }
            }
        }
    
        // For baking: Use GH_Brep's built-in methods
        if (brepToBake != null)
        {
            Grasshopper.Kernel.Types.GH_Brep ghBrepToBake = brepToBake as Grasshopper.Kernel.Types.GH_Brep;
            if (ghBrepToBake != null)
            {
                Rhino.Geometry.Brep rhinoBrep = null;
                ghBrepToBake.CastTo(ref rhinoBrep);
            
                if (rhinoBrep != null)
                {
                    var attributes = new Rhino.DocObjects.ObjectAttributes();
                    doc.Objects.AddBrep(rhinoBrep, attributes);
                }
            }
        }
    
        doc.Views.Redraw();
}




}
# ---------- end c_script ----------
c_script_2 = CSharpScript(Go=Button(), B=rotate.Geometry)  # -> out; inputs Go: Boolean, B: Brep
# ---------- c_script_2: C# ----------
using System;
using System.Collections;
using System.Collections.Generic;

using Rhino;
using Rhino.Geometry;
using Grasshopper;
using Grasshopper.Kernel;
using Grasshopper.Kernel.Data;
using Grasshopper.Kernel.Types;

/// <summary>
/// This class will be instantiated on demand by the Script component.
/// </summary>
public class Script_Instance : GH_ScriptInstance
{
    #region Utility functions
    /// <summary>Print a String to the [Out] Parameter of the Script component.</summary>
    /// <param name="text">String to print.</param>
    private void Print(string text) { /* Implementation hidden */ }
    /// <summary>Print a formatted String to the [Out] Parameter of the Script component.</summary>
    /// <param name="format">String format.</param>
    /// <param name="args">Formatting parameters.</param>
    private void Print(string format, params object[] args) { /* Implementation hidden */ }
    /// <summary>Print useful information about an object instance to the [Out] Parameter of the Script component. </summary>
    /// <param name="obj">Object instance to parse.</param>
    private void Reflect(object obj) { /* Implementation hidden */ }
    /// <summary>Print useful information about an object instance to the [Out] Parameter of the Script component. </summary>
    /// <param name="obj">Object instance to parse.</param>
    /// <param name="method_name">Name of the method to invoke.</param>
    private void Reflect(object obj, string method_name) { /* Implementation hidden */ }
    #endregion

    #region Members
    /// <summary>Gets the current Rhino document.</summary>
    private readonly RhinoDoc RhinoDocument;
    /// <summary>Gets the current Grasshopper document.</summary>
    private readonly GH_Document GrasshopperDocument;
    /// <summary>Gets the Grasshopper script component that owns this script.</summary>
    private readonly IGH_Component Component;
    /// <summary>Gets the current iteration count.</summary>
    private readonly int Iteration;
    #endregion

    /// <summary>
    /// This procedure contains the user code. Input parameters are provided as regular arguments, 
    /// Output parameters as ref arguments. You don't have to assign output parameters, 
    /// they will have a default value.
    /// </summary>
    private void RunScript(bool Go, Brep B)
  {
    if(Go)
    {
      Rhino.DocObjects.ObjectAttributes objectAttributes = new Rhino.DocObjects.ObjectAttributes();
      objectAttributes.LayerIndex = 2;
      Rhino.RhinoDoc.ActiveDoc.Objects.AddBrep(B, objectAttributes);
    }
  }
}
# ---------- end c_script_2 ----------
pdecon = Deconstruct(Point=move.Geometry)  # -> XComponent, YComponent, ZComponent
pdecon_2 = Deconstruct(Point=move_2.Geometry)  # -> XComponent, YComponent, ZComponent
py3_2 = Python3Script(pts=merge_2, XYforXYZ=Toggle(True), refresh=Button())  # -> out, oriented; inputs pts: Point3d, XYforXYZ: Boolean, refresh: Boolean; disabled; same code as py3
trigger_3 = Trigger(Interval=10, TimerInterval=10, Target=py3_3)  # disabled
xy_2 = XYPlane(Origin=Point(0, 0, 0))
pt = ConstructPoint(XCoordinate=pdecon_2.XComponent, YCoordinate=pdecon_2.YComponent, ZCoordinate=pdecon.ZComponent)
merge_3 = Merge(Data1=boxprop.Center)
ln = Line(StartPoint=move.Geometry, EndPoint=pt)
angle_2 = Angle(VectorA=evalsrf_2.Normal, VectorB=py3_2.oriented, Plane=xy_2)  # -> Angle, Reflex
py3_3 = Python3Script(pts=merge_3, XYforXYZ=Toggle(True), refresh=Button())  # -> out, oriented; inputs pts: Point3d, XYforXYZ: Boolean, refresh: Boolean; disabled; same code as py3
hframe = HorizontalFrame(Curve=ln, Parameter=".5")
id = Guid(brep_3)
rotax = RotateAxis(Geometry=hframe, Angle=1.570796327, Axis=ln)  # -> Geometry, Transform
xy_3 = XYPlane(Origin=Point(0, 0, 0))
rotate_2 = Rotate(Geometry=brep_3, Angle=angle_2.Angle, Plane=area_2.Centroid)  # -> Geometry, Transform
number_slider = Slider(16, range=0..20)
button = Button()
crv = Curve(<curve referenced from the Rhino model>)
random = Random(Range=number_slider, Number=Slider(3, range=0..20), Seed=2)
random_2 = Random(Range=number_slider, Number=Slider(20, range=0..20), Seed=Slider(9, range=0..20))
divide = DivideCurve(Curve=crv, Count=number_slider, Kinks=False)  # -> Points, Tangents, Parameters
xy_4 = XYPlane(Origin=rotax.Geometry)
block_instance_3 = ModelBlockInstance(BlockInstance=block_instance_2.BlockInstance)  # -> BlockInstance, Transform, BlockDefinition
angle_3 = Angle(VectorA=rotax.Geometry, VectorB=py3_3.oriented, Plane=xy_3)  # -> Angle, Reflex
layername_3 = Text(layername_2)

# ----
# <---- Works with Query Function for Layer pick
c_script_3 = CSharpScript(trigger=Button(), B=rotate_2.Geometry, guids=id, LayerName=layername_3)  # -> out, A; inputs trigger: Boolean, B: Brep, guids: list of Guid, LayerName: String
# ---------- c_script_3: C# ----------
using System;
using System.Collections;
using System.Collections.Generic;

using Rhino;
using Rhino.Geometry;
using Grasshopper;
using Grasshopper.Kernel;
using Grasshopper.Kernel.Data;
using Grasshopper.Kernel.Types;

/// <summary>
/// This class will be instantiated on demand by the Script component.
/// </summary>
public class Script_Instance : GH_ScriptInstance
{
    #region Utility functions
    /// <summary>Print a String to the [Out] Parameter of the Script component.</summary>
    /// <param name="text">String to print.</param>
    private void Print(string text) { /* Implementation hidden */ }
    /// <summary>Print a formatted String to the [Out] Parameter of the Script component.</summary>
    /// <param name="format">String format.</param>
    /// <param name="args">Formatting parameters.</param>
    private void Print(string format, params object[] args) { /* Implementation hidden */ }
    /// <summary>Print useful information about an object instance to the [Out] Parameter of the Script component. </summary>
    /// <param name="obj">Object instance to parse.</param>
    private void Reflect(object obj) { /* Implementation hidden */ }
    /// <summary>Print useful information about an object instance to the [Out] Parameter of the Script component. </summary>
    /// <param name="obj">Object instance to parse.</param>
    /// <param name="method_name">Name of the method to invoke.</param>
    private void Reflect(object obj, string method_name) { /* Implementation hidden */ }
    #endregion

    #region Members
    /// <summary>Gets the current Rhino document.</summary>
    private readonly RhinoDoc RhinoDocument;
    /// <summary>Gets the current Grasshopper document.</summary>
    private readonly GH_Document GrasshopperDocument;
    /// <summary>Gets the Grasshopper script component that owns this script.</summary>
    private readonly IGH_Component Component;
    /// <summary>Gets the current iteration count.</summary>
    private readonly int Iteration;
    #endregion

    /// <summary>
    /// This procedure contains the user code. Input parameters are provided as regular arguments, 
    /// Output parameters as ref arguments. You don't have to assign output parameters, 
    /// they will have a default value.
    /// </summary>
    private void RunScript(
	bool trigger,
	Brep B,
	List<Guid> guids,
	string LayerName,
	ref object A)
    {
        if(trigger)
        {
            // Get the active document
            Rhino.RhinoDoc doc = Rhino.RhinoDoc.ActiveDoc;
    
            // Look for the "LayerName" layer
            int peopleLayerIndex = -1;
            for (int i = 0; i < doc.Layers.Count; i++)
            {
                if (doc.Layers[i].Name.ToLower() == LayerName.ToLower())
                {
                    peopleLayerIndex = i;
                    break;
                }
            }
    
            // Create object attributes and set the layer index
            //Rhino.DocObjects.ObjectAttributes objectAttributes = new Rhino.DocObjects.ObjectAttributes();
            //objectAttributes.LayerIndex = peopleLayerIndex;
    
            // First bake the object to get its ID
            Guid newObjectId = Rhino.RhinoDoc.ActiveDoc.Objects.AddBrep(B);

            if(guids != null)
            {
                foreach(Guid guid in guids)
                {
                    Rhino.RhinoDoc.ActiveDoc.Objects.Delete(guid, true);
                }
                Rhino.RhinoDoc.ActiveDoc.Views.Redraw();
                A = $"Deleted {guids.Count} objects";
            }

            // Then move it to the "People" layer
            // Get the object, modify its layer, and update it
            Rhino.DocObjects.RhinoObject obj = doc.Objects.Find(newObjectId);
            Rhino.DocObjects.ObjectAttributes attr = obj.Attributes;
            attr.LayerIndex = peopleLayerIndex;
            doc.Objects.ModifyAttributes(newObjectId, attr, true);
            
        }
    }
}
# ---------- end c_script_3 ----------

c_script_4 = CSharpScript(guids=id, trigger=Button())  # -> out, A; inputs guids: list of Guid, trigger: Boolean; disabled
# ---------- c_script_4: C# ----------
using System;
using System.Collections;
using System.Collections.Generic;

using Rhino;
using Rhino.Geometry;
using Grasshopper;
using Grasshopper.Kernel;
using Grasshopper.Kernel.Data;
using Grasshopper.Kernel.Types;

/// <summary>
/// This class will be instantiated on demand by the Script component.
/// </summary>
public class Script_Instance : GH_ScriptInstance
{
    #region Utility functions
    /// <summary>Print a String to the [Out] Parameter of the Script component.</summary>
    /// <param name="text">String to print.</param>
    private void Print(string text) { /* Implementation hidden */ }
    /// <summary>Print a formatted String to the [Out] Parameter of the Script component.</summary>
    /// <param name="format">String format.</param>
    /// <param name="args">Formatting parameters.</param>
    private void Print(string format, params object[] args) { /* Implementation hidden */ }
    /// <summary>Print useful information about an object instance to the [Out] Parameter of the Script component. </summary>
    /// <param name="obj">Object instance to parse.</param>
    private void Reflect(object obj) { /* Implementation hidden */ }
    /// <summary>Print useful information about an object instance to the [Out] Parameter of the Script component. </summary>
    /// <param name="obj">Object instance to parse.</param>
    /// <param name="method_name">Name of the method to invoke.</param>
    private void Reflect(object obj, string method_name) { /* Implementation hidden */ }
    #endregion

    #region Members
    /// <summary>Gets the current Rhino document.</summary>
    private readonly RhinoDoc RhinoDocument;
    /// <summary>Gets the current Grasshopper document.</summary>
    private readonly GH_Document GrasshopperDocument;
    /// <summary>Gets the Grasshopper script component that owns this script.</summary>
    private readonly IGH_Component Component;
    /// <summary>Gets the current iteration count.</summary>
    private readonly int Iteration;
    #endregion

    /// <summary>
    /// This procedure contains the user code. Input parameters are provided as regular arguments, 
    /// Output parameters as ref arguments. You don't have to assign output parameters, 
    /// they will have a default value.
    /// </summary>
    private void RunScript(List<Guid> guids, bool trigger, ref object A)
    {
        if(trigger && guids != null)
        {
            foreach(Guid guid in guids)
            {
                Rhino.RhinoDoc.ActiveDoc.Objects.Delete(guid, true);
            }
            Rhino.RhinoDoc.ActiveDoc.Views.Redraw();
            A = $"Deleted {guids.Count} objects";
        }
    }   
}
# ---------- end c_script_4 ----------

# ----
# <---- Works with Query Function for Layer pick
c_script_5 = CSharpScript(trigger=button, B=rotate_2.Geometry, guids=id)  # -> out, A; inputs trigger: Boolean, B: Brep, guids: list of Guid; disabled
# ---------- c_script_5: C# ----------
using System;
using System.Collections;
using System.Collections.Generic;

using Rhino;
using Rhino.Geometry;
using Grasshopper;
using Grasshopper.Kernel;
using Grasshopper.Kernel.Data;
using Grasshopper.Kernel.Types;

/// <summary>
/// This class will be instantiated on demand by the Script component.
/// </summary>
public class Script_Instance : GH_ScriptInstance
{
    #region Utility functions
    /// <summary>Print a String to the [Out] Parameter of the Script component.</summary>
    /// <param name="text">String to print.</param>
    private void Print(string text) { /* Implementation hidden */ }
    /// <summary>Print a formatted String to the [Out] Parameter of the Script component.</summary>
    /// <param name="format">String format.</param>
    /// <param name="args">Formatting parameters.</param>
    private void Print(string format, params object[] args) { /* Implementation hidden */ }
    /// <summary>Print useful information about an object instance to the [Out] Parameter of the Script component. </summary>
    /// <param name="obj">Object instance to parse.</param>
    private void Reflect(object obj) { /* Implementation hidden */ }
    /// <summary>Print useful information about an object instance to the [Out] Parameter of the Script component. </summary>
    /// <param name="obj">Object instance to parse.</param>
    /// <param name="method_name">Name of the method to invoke.</param>
    private void Reflect(object obj, string method_name) { /* Implementation hidden */ }
    #endregion

    #region Members
    /// <summary>Gets the current Rhino document.</summary>
    private readonly RhinoDoc RhinoDocument;
    /// <summary>Gets the current Grasshopper document.</summary>
    private readonly GH_Document GrasshopperDocument;
    /// <summary>Gets the Grasshopper script component that owns this script.</summary>
    private readonly IGH_Component Component;
    /// <summary>Gets the current iteration count.</summary>
    private readonly int Iteration;
    #endregion

    /// <summary>
    /// This procedure contains the user code. Input parameters are provided as regular arguments, 
    /// Output parameters as ref arguments. You don't have to assign output parameters, 
    /// they will have a default value.
    /// </summary>
    private void RunScript(bool trigger, Brep B, List<Guid> guids, ref object A)
    {
        if(trigger)
        {
            // Get the active document
            Rhino.RhinoDoc doc = Rhino.RhinoDoc.ActiveDoc;
    
            // Look for the "People" layer
            int peopleLayerIndex = -1;
            for (int i = 0; i < doc.Layers.Count; i++)
            {
                if (doc.Layers[i].Name.ToLower() == "people")
                {
                    peopleLayerIndex = i;
                    break;
                }
            }
    
            // If "People" layer doesn't exist, create it
            if (peopleLayerIndex == -1)
            {
                Rhino.DocObjects.Layer peopleLayer = new Rhino.DocObjects.Layer();
                peopleLayer.Name = "People";
                peopleLayerIndex = doc.Layers.Add(peopleLayer);
            }

            if(trigger && guids != null)
        {
            foreach(Guid guid in guids)
            {
                Rhino.RhinoDoc.ActiveDoc.Objects.Delete(guid, true);
            }
            Rhino.RhinoDoc.ActiveDoc.Views.Redraw();
            A = $"Deleted {guids.Count} objects";
        }
    
            // Create object attributes and set the layer index
            Rhino.DocObjects.ObjectAttributes objectAttributes = new Rhino.DocObjects.ObjectAttributes();
            objectAttributes.LayerIndex = peopleLayerIndex;
    
            // Add the Brep to the document with the specified attributes
            doc.Objects.AddBrep(B, objectAttributes);
        }
    }
}
# ---------- end c_script_5 ----------

item = ListItem(List=divide.Points, Index=random_2, Wrap=True)
rotate_3 = Rotate(Geometry=block_instance_3.BlockInstance, Angle=angle_3.Angle, Plane=xy_4)  # -> Geometry, Transform
c_script_6 = CSharpScript(Go=button, B=rotate_2.Geometry)  # -> out; inputs Go: Boolean, B: Brep; disabled
# ---------- c_script_6: C# ----------
using System;
using System.Collections;
using System.Collections.Generic;

using Rhino;
using Rhino.Geometry;
using Grasshopper;
using Grasshopper.Kernel;
using Grasshopper.Kernel.Data;
using Grasshopper.Kernel.Types;

/// <summary>
/// This class will be instantiated on demand by the Script component.
/// </summary>
public class Script_Instance : GH_ScriptInstance
{
    #region Utility functions
    /// <summary>Print a String to the [Out] Parameter of the Script component.</summary>
    /// <param name="text">String to print.</param>
    private void Print(string text) { /* Implementation hidden */ }
    /// <summary>Print a formatted String to the [Out] Parameter of the Script component.</summary>
    /// <param name="format">String format.</param>
    /// <param name="args">Formatting parameters.</param>
    private void Print(string format, params object[] args) { /* Implementation hidden */ }
    /// <summary>Print useful information about an object instance to the [Out] Parameter of the Script component. </summary>
    /// <param name="obj">Object instance to parse.</param>
    private void Reflect(object obj) { /* Implementation hidden */ }
    /// <summary>Print useful information about an object instance to the [Out] Parameter of the Script component. </summary>
    /// <param name="obj">Object instance to parse.</param>
    /// <param name="method_name">Name of the method to invoke.</param>
    private void Reflect(object obj, string method_name) { /* Implementation hidden */ }
    #endregion

    #region Members
    /// <summary>Gets the current Rhino document.</summary>
    private readonly RhinoDoc RhinoDocument;
    /// <summary>Gets the current Grasshopper document.</summary>
    private readonly GH_Document GrasshopperDocument;
    /// <summary>Gets the Grasshopper script component that owns this script.</summary>
    private readonly IGH_Component Component;
    /// <summary>Gets the current iteration count.</summary>
    private readonly int Iteration;
    #endregion

    /// <summary>
    /// This procedure contains the user code. Input parameters are provided as regular arguments, 
    /// Output parameters as ref arguments. You don't have to assign output parameters, 
    /// they will have a default value.
    /// </summary>
    private void RunScript(bool Go, Brep B)
    {
        if(Go)
        {
            // Get the active document
            Rhino.RhinoDoc doc = Rhino.RhinoDoc.ActiveDoc;
    
            // Look for the "People" layer
            int peopleLayerIndex = -1;
            for (int i = 0; i < doc.Layers.Count; i++)
            {
                if (doc.Layers[i].Name.ToLower() == "people")
                {
                    peopleLayerIndex = i;
                    break;
                }
            }
    
            // If "People" layer doesn't exist, create it
            if (peopleLayerIndex == -1)
            {
                Rhino.DocObjects.Layer peopleLayer = new Rhino.DocObjects.Layer();
                peopleLayer.Name = "People";
                peopleLayerIndex = doc.Layers.Add(peopleLayer);
            }
    
            // Create object attributes and set the layer index
            Rhino.DocObjects.ObjectAttributes objectAttributes = new Rhino.DocObjects.ObjectAttributes();
            objectAttributes.LayerIndex = peopleLayerIndex;
    
            // Add the Brep to the document with the specified attributes
            doc.Objects.AddBrep(B, objectAttributes);
        }
    }
}
# ---------- end c_script_6 ----------
cull_i = CullIndex(List=divide.Points, Indices=random_2, Wrap=True)
vec2pt = Vector2Pt(PointA=xy_4, PointB="0,0,0", Unitize=False)  # -> Vector, Length
block_definition = QueryModelBlockDefinitions(Name="Tree", AutoUpdateState=True)
item_2 = ListItem(List=panel_2, Index=Slider(0, range=0..4), Wrap=True)
block_definition_2 = ModelBlockDefinition()  # -> BlockDefinition, Objects, Name
item_3 = ListItem(List=cull_i, Index=random, Wrap=True)
block_definition_3 = ModelBlockDefinition(Name=item_2)  # -> BlockDefinition, Objects, Name
button_2 = Button()
item_4 = ListItem(List=block_definition, Index=Slider(23, range=0..500), Wrap=True)
layername_4 = Text(layername)
Z = UnitZ(Factor="1")
block_instance_4 = ModelBlockInstance(Transform=vec2pt.Vector, BlockDefinition=block_definition_3.BlockDefinition)  # -> BlockInstance, Transform, BlockDefinition
panel_7 = Panel(item_4)
dist = Distance(PointA=item, PointB=item_3)
move_3 = Move(Geometry=item, Motion=Z)  # -> Geometry, Transform
ln_2 = Line(StartPoint=item_3, EndPoint=item)
Z_2 = UnitZ(Factor=expr("x*(.5)", dist))
midpt = CurveMiddle(Curve=ln_2)
pl_3pt = Plane3Pt(PointA=move_3.Geometry, PointB=item, PointC=graft(item_3))
move_4 = Move(Geometry=midpt, Motion=Z_2)  # -> Geometry, Transform
arc = Arc(Plane=pl_3pt, Radius=dist, Angle=Domain(1.570796327, 3.141592654))  # -> Arc, Length
move_5 = Move(Geometry=arc.Arc, Motion=expr("x*(-1)", Z))  # -> Geometry, Transform
arc_2 = Arc3Pt(PointA=item_3, PointB=move_4.Geometry, PointC=item)  # -> Arc, Plane, Radius
panel_8 = Panel(arc.Arc)
